# Grasshopper definition Relative Robots.gh (Grasshopper 1.0.8)

# ----
# Steps
number_slider = Slider(500, range=0..1000)
number_slider_2 = Slider(162, range=0..162)
python_3_script = Python3Script(
    play=Toggle(True),
    reset=Button(),
    loop=Toggle(False),
    max_step=number_slider,
    interval_ms=Slider(10, range=0..100000),
    step_size=Slider(1, range=0..10))  # -> out, S_auto
# ---------- python_3_script: Python ----------
import scriptcontext as sc
import Grasshopper as gh

# ---------------------------------------------------------
# Grasshopper-Komponente und eindeutiger Speichername
# ---------------------------------------------------------
component = ghenv.Component
counter_key = "rhombe_counter_" + str(component.InstanceGuid)

# ---------------------------------------------------------
# Eingaben absichern
# ---------------------------------------------------------
maximum = max(0, int(max_step if max_step is not None else 0))
delay = max(20, int(interval_ms if interval_ms is not None else 100))
increment = max(1, int(step_size if step_size is not None else 1))

is_playing = bool(play)
should_loop = bool(loop)
should_reset = bool(reset)

# ---------------------------------------------------------
# Counter laden oder zurücksetzen
# ---------------------------------------------------------
if should_reset or counter_key not in sc.sticky:
    current_step = 0
    sc.sticky[counter_key] = 0
else:
    current_step = int(sc.sticky[counter_key])

# Counter auf gültigen Bereich begrenzen
current_step = max(0, min(current_step, maximum))

# ---------------------------------------------------------
# Aktuellen Schritt an Grasshopper ausgeben
# ---------------------------------------------------------
S_auto = current_step

# ---------------------------------------------------------
# Nächsten Schritt berechnen
# ---------------------------------------------------------
schedule_next = False

if is_playing:

    if current_step < maximum:
        next_step = current_step + increment

        if next_step > maximum:
            next_step = maximum

        sc.sticky[counter_key] = next_step
        schedule_next = True

    elif should_loop and maximum > 0:
        sc.sticky[counter_key] = 0
        schedule_next = True

    else:
        # Am Ende stehen bleiben
        sc.sticky[counter_key] = maximum

else:
    # Pause: aktuellen Wert behalten
    sc.sticky[counter_key] = current_step

# ---------------------------------------------------------
# Nächste Grasshopper-Berechnung automatisch starten
# ---------------------------------------------------------
if schedule_next:

    def update_solution(document):
        component.ExpireSolution(False)

    document = component.OnPingDocument()

    if document is not None:
        callback = gh.Kernel.GH_Document.GH_ScheduleDelegate(
            update_solution
        )

        document.ScheduleSolution(
            delay,
            callback
        )
# ---------- end python_3_script ----------

# ----
# Stone
schritte = Slider(4, range=0..1000)
schritte_2 = Slider(4, range=0..1000)
schritte_3 = Slider(0, range=0..1000)

# ----
# Left Foot
v_link = Slider(14, range=0..100)
u_link = Slider(14, range=0..100)
w_link = Slider(4, range=0..10)

# ----
# RightFoot
u_recht = Slider(13, range=0..100)
v_recht = Slider(16, range=0..100)
w_recht = Slider(2, range=0..10)

schritte_4 = Slider(30, range=0..200)
python_3_script_2 = Python3Script(
    S=python_3_script.S_auto,
    stoneU=schritte_2,
    stoneV=schritte_3,
    stoneW=schritte,
    targetUL=u_link,
    targetVL=v_link,
    targetWL=w_link,
    targetUR=u_recht,
    targetVR=v_recht,
    targetWR=w_recht,
    project_path="D:\Promotion\Rhomb-E\Simulation\Simulation Rhomb E",
    reload_code=Button())  # -> uL_out, vL_out, wL_out, uR_out, vR_out, wR_out, last_step, isCarrying_out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; inputs project_path: String
# ---------- python_3_script_2: Python ----------
"""Test bridge for the complete D1+B2+D2+D3 assembly cycle: pick up a
block, carry it to a target, place it, and return home - matching the
paper's "approaching, gripping, transporting, placing, and returning".

Grasshopper inputs:
    S, stoneU, stoneV, stoneW,
    targetUL, targetVL, targetWL, targetUR, targetVR, targetWR,
    occupiedU, occupiedV,
    project_path, reload_code

Grasshopper outputs:
    uL_out, vL_out, wL_out, uR_out, vR_out, wR_out,
    isCarrying_out, stonePlaced_out, last_step,
    occupiedU_out, occupiedV_out

``targetU/V/WL`` and ``targetU/V/WR`` describe where the robot should be
standing right after placing the block (see complete_assembly_cycle's
docstring in rhombe_motion/work_sequences.py for the exact meaning of the
carrying foot's w there).

``occupiedU``/``occupiedV`` (optional, parallel lists) describe (u, v)
columns already built on by EARLIER assembly cycles - wire the previous
run's ``occupiedU_out``/``occupiedV_out`` back into these two inputs to
chain multiple placements in the same build, so this cycle's pickup,
transport and return legs never try to plant a foot back inside a column
built on earlier. Leave both empty for the very first stone.

``isCarrying_out`` is True/False for the current step S - wire it to a
Boolean toggle / Gate / IF component to show or hide the block attached
to the robot's foot (visible only while actually being carried).

``stonePlaced_out`` is a SEPARATE True/False signal for the current step
S: it becomes True the moment the block reaches its final voxel and
STAYS True for the rest of the cycle (through release and the whole trip
home), unlike isCarrying_out, which goes False right after release. Wire
this to a persistent "keep showing the block resting at its target"
toggle.

``occupiedU_out``/``occupiedV_out`` are this cycle's ``occupiedU``/
``occupiedV`` plus the column this cycle itself just placed a stone in -
feed them into the NEXT assembly-cycle component's ``occupiedU``/
``occupiedV`` inputs to keep building on the same structure.
"""

import importlib
import sys

if project_path and project_path not in sys.path:
    sys.path.insert(0, project_path)

import rhombe_motion.primitives as primitives
import rhombe_motion.simple_motion as simple_motion
import rhombe_motion.behaviors as behaviors
import rhombe_motion.work_sequences as work_sequences

if reload_code:
    # Reload in dependency order: primitives -> behaviors -> work_sequences
    # (each imports names from the one before it via "from X import Y").
    # Reloading only work_sequences (as this used to do) re-runs its
    # import statements, but those just re-bind names from whatever
    # primitives/behaviors modules already sit in sys.modules - if THOSE
    # were never reloaded, edits to behaviors.py or primitives.py stay
    # invisible for the rest of the Rhino session no matter how many
    # times reload_code is toggled, until Rhino is fully restarted. This
    # was very likely the cause of the repeated "nothing changed" reports.
    primitives = importlib.reload(primitives)
    simple_motion = importlib.reload(simple_motion)
    behaviors = importlib.reload(behaviors)
    work_sequences = importlib.reload(work_sequences)

target_pose = simple_motion.Pose(
    int(targetUL), int(targetVL), int(targetWL),
    int(targetUR), int(targetVR), int(targetWR))

occupied_in = set()
if occupiedU and occupiedV:
    occupied_in = set(zip((int(u) for u in occupiedU), (int(v) for v in occupiedV)))

poses, is_carrying, stone_placed, occupied_out = work_sequences.complete_assembly_cycle(
    simple_motion.START_POSE,
    int(stoneU), int(stoneV), int(stoneW),
    target_pose,
    occupied=occupied_in)

step = max(0, min(int(S), len(poses) - 1))
pose = poses[step]

uL_out, vL_out, wL_out, uR_out, vR_out, wR_out = pose.as_tuple()
isCarrying_out = is_carrying[step]
stonePlaced_out = stone_placed[step]
last_step = len(poses) - 1

occupiedU_out = [c[0] for c in sorted(occupied_out)]
occupiedV_out = [c[1] for c in sorted(occupied_out)]
# ---------- end python_3_script_2 ----------

# ----
# Left Leg Length (pt_A)
# Right Leg Length (pt_B)
number_slider_3 = Slider(19.1, range=0..100)
number_slider_4 = Slider(16.6, range=0..100)

# ----
# Grid - Landscape
number_slider_5 = Slider(20, range=0..100)
number_slider_6 = Slider(2.8, range=0..10)
sqgrid = Square(Plane=PlaneXY(0, 0, 0), Size=number_slider_6, ExtentX=number_slider_5, ExtentY=number_slider_5)  # -> simplify(Cells), simplify(Points)

# ----
# 2D Grid
rec = Rectangle(sqgrid.Cells)

# ----
# Left Foot
# U - Cell
# V - Cell
# W - Cell
# RightFoot
# U - Cell
# V - Cell
# W - Cell
number_slider_7 = Slider(33, range=0..100)
number_slider_8 = Slider(56, range=0..100)
number_slider_9 = Slider(3, range=1..10)
number_slider_10 = Slider(33, range=0..100)
number_slider_11 = Slider(63, range=0..100)
number_slider_12 = Slider(1, range=1..10)
num = Number(number_slider_6)
multiplication = Multiplication(A=python_3_script_2.wL_out, B=num)
multiplication_2 = Multiplication(A=python_3_script_2.wR_out, B=num)
item = ListItem(List=rec, Index=python_3_script_2.uL_out, Wrap=True)  # -> flatten(Item)
item_2 = ListItem(List=rec, Index=python_3_script_2.uR_out, Wrap=True)  # -> flatten(Item)
item_3 = ListItem(List=item, Index=python_3_script_2.vL_out, Wrap=True)  # -> flatten(Item)
item_4 = ListItem(List=item_2, Index=python_3_script_2.vR_out, Wrap=True)  # -> flatten(Item)
Z = UnitZ(Factor=1)
Z_2 = UnitZ(Factor=1)
facen = FaceNormals(Mesh=item_4)  # -> Centers, Normals
facen_2 = FaceNormals(Mesh=item_3)  # -> Centers, Normals
boundary = BoundarySurfaces(Edges=item_4)
multiplication_3 = Multiplication(A=Z, B=multiplication)
multiplication_4 = Multiplication(A=Z_2, B=multiplication_2)
boundary_2 = BoundarySurfaces(Edges=item_3)
addition = Addition(A=facen.Centers, B=multiplication_4)
addition_2 = Addition(A=facen_2.Centers, B=multiplication_3)

pt_a = Point(addition)
pt_b = Point(addition_2)
# Stence Width
ln_c = Line(StartPoint=pt_a, EndPoint=pt_b)
cluster = Cluster(C=ln_c)  # -> M, L
tag = TextTag(Location=cluster.M, Text=cluster.L)
python = GhPythonScript(a=number_slider_3, b=number_slider_4, pt_A=pt_a, pt_B=pt_b)  # -> out, angleA, angleB, angleC, heightC, base_a, base_b, normal; inputs pt_A: Point3d, pt_B: Point3d
# ---------- python: Python ----------
__author__ = "dma.mirco"

import rhinoscriptsyntax as rs
import math

c = rs.Distance(pt_A, pt_B)

#if a and b are not equal:
cosC = (c**2-a**2 -b**2 )/ (- 2*b*a)
print cosC
angleC = math.acos(float(cosC))

#find the height of the triangel (three sides given): Heron's Formula
s = (a+b+c)/2
S = math.sqrt(s*(s-a)*(s-b)*(s-c))
heightC = 2*S/c
base_a = math.sqrt(a**2 - heightC**2)
normal = rs.VectorCrossProduct(rs.VectorSubtract(pt_A, pt_B), (0.0, 0.0, 1.0))
normal = rs.VectorUnitize(normal)
# ---------- end python ----------
panel = Panel(python.base_a)
deg = Degrees(Radians=python.angleB)
deg_2 = Degrees(Radians=python.angleA)
deg_3 = Degrees(Radians=python.angleC)
panel_2 = Panel(python.heightC)
panel_3 = Panel(python.base_a)
panel_4 = Panel(deg)
panel_5 = Panel(deg_2)
panel_6 = Panel(deg_3)
pt_a_2 = Point(pt_a)
pt_b_2 = Point(pt_b)

# ----
# Cone at Right Leg
# Left Leg Length (pt_A)
# Right Leg Length (pt_B)
# U - Cell
# V - Cell
# W - Cell
# 2D Grid
# U - Cell
# V - Cell
# W - Cell
# Stence Width
pl = PlaneNormal(Origin=pt_a_2, ZAxis=python.normal)
cone = Cone(Base=pl, Radius=1, Length=5)  # -> Cone, Tip
# Left Leg Length (pt_A)
# Right Leg Length (pt_A)
# Build Triangle Points with Vectors
# pt_C
# Left Leg Length (pt_A)
# Right Leg Length (pt_A)
# Box around Right Leg
# Build Triangle Points with Vectors
# pt_C
# Cone at Right Leg
# Box around Left Leg
# Left Leg Length (pt_A)
# Right Leg Length (pt_A)
# Box around Right Leg
# Build Triangle Points with Vectors
# pt_C
# Cone at Right Leg
preview = CustomPreview(
    Geometry=cone.Cone,
    Material={diffuse=RGB(228, 178, 227), emission=RGB(68, 53, 68), shine=0.5, specular=RGB(255, 254, 254), transparency=0})

# ----
# Build Triangle Points with Vectors
cluster_2 = Cluster_2(pt=pt_b_2, B=pt_a_2, B_2=panel_3, B_3=panel_2)  # -> R_2, R

number_slider_13 = Slider(0.5, range=0..10)
number_slider_14 = Slider(2.7, range=0..10)

# ----
# pt_C
addition_3 = Addition(A=cluster_2.R_2, B=cluster_2.R)

# ----
# Left Leg Length (pt_A)
ln__a = Line(StartPoint=pt_b_2, EndPoint=addition_3)
# Right Leg Length (pt_A)
ln_b = Line(StartPoint=pt_a_2, EndPoint=addition_3)

area = Area(Geometry=sqgrid.Cells)  # -> Area, Centroid
box_rectangle = BoxRectangle(Rectangle=sqgrid.Cells, Height=Slider(1, range=0..1))
scale = Scale(Geometry=box_rectangle, Center=area.Centroid, Factor=Slider(0.93, range=0..1))  # -> Geometry, Transform
pipe = Pipe(Curve=[ln__a, ln_b], Radius=Slider(0.1, range=0..0.1), Caps=0, FitRail=False)
preview_2 = CustomPreview(
    Geometry=[scale.Geometry, pipe],
    Material={diffuse=RGB(228, 178, 227), emission=RGB(68, 53, 68), shine=0.5, specular=RGB(255, 254, 254), transparency=0})

cluster_3 = Cluster(C=ln__a)  # -> M, L
cluster_4 = Cluster(C=ln_b)  # -> M, L
tag_2 = TextTag(Location=cluster_3.M, Text=cluster_3.L)
tag_3 = TextTag(Location=cluster_4.M, Text=cluster_4.L)
num_2 = Number()
num_3 = Number()

# ----
# Box around Right Leg
pframe = PerpFrame(Curve=ln_b, Parameter=0)
num_4 = Number(number_slider_4)
align = AlignPlane(Plane=pframe, Direction=python.normal)  # -> Plane, Angle
pl_offset = PlaneOffset(BasePlane=align.Plane, Offset=number_slider_14)
dom = ConstructDomain(DomainStart=number_slider_13, DomainEnd=expr("x * (-1.0)", number_slider_13))
multiplication_5 = Multiplication(A=number_slider_14, B=2)
subtraction = Subtraction(A=num_4, B=multiplication_5)
rectangle = Rectangle(Plane=pl_offset, XSize=dom, YSize=dom, Radius=0)  # -> Rectangle, Length
boxrec = BoxRectangle(Rectangle=rectangle.Rectangle, Height=subtraction)
preview_3 = CustomPreview(
    Geometry=boxrec,
    Material={diffuse=RGB(228, 178, 227), emission=RGB(68, 53, 68), shine=0.5, specular=RGB(255, 254, 254), transparency=0})

# ----
# Box around Left Leg
pframe_2 = PerpFrame(Curve=ln__a, Parameter=0)
num_5 = Number(number_slider_3)
align_2 = AlignPlane(Plane=pframe_2, Direction=python.normal)  # -> Plane, Angle
pl_offset_2 = PlaneOffset(BasePlane=align_2.Plane, Offset=number_slider_14)
dom_2 = ConstructDomain(DomainStart=number_slider_13, DomainEnd=expr("x * (-1.0)", number_slider_13))
multiplication_6 = Multiplication(A=number_slider_14, B=2)
subtraction_2 = Subtraction(A=num_5, B=multiplication_6)
rectangle_2 = Rectangle(Plane=pl_offset_2, XSize=dom_2, YSize=dom_2, Radius=0)  # -> Rectangle, Length
boxrec_2 = BoxRectangle(Rectangle=rectangle_2.Rectangle, Height=subtraction_2)
preview_4 = CustomPreview(
    Geometry=boxrec_2,
    Material={diffuse=RGB(228, 178, 227), emission=RGB(68, 53, 68), shine=0.5, specular=RGB(255, 254, 254), transparency=0})

lnln = LineLine(LineA=ln__a, LineB=ln_b)
pl_2 = ConstructPlane(Origin=addition_3, XAxis=Vector(1, 0, 0), YAxis=Vector(0, 1, 0))
panel_7 = Panel("""2
6
8
4""")
compass_0_2 = Compass02(pln=lnln, num=Slider(3.645, range=0..10))  # -> C, L_3, L_2, L, G
panel_8 = Panel("""0
90
180
270""")
crv = Curve([compass_0_2.L_3, compass_0_2.C, compass_0_2.L_2, compass_0_2.L])
tag_4 = TextTag3D(Location=flatten(compass_0_2.G), Text=flatten(panel_8), Size=Slider(0.514, range=0..1), Justification=panel_7)

# ----
# Box Feet
number_slider_15 = Slider(1, range=0..10)
number_slider_16 = Slider(1, range=0..1)
pt = Point(pt_a_2)
pt_2 = Point(pt_b_2)
num_6 = Number(number_slider_6)
xy = XYPlane(Origin=pt)
xy_2 = XYPlane(Origin=pt_2)
dom_3 = ConstructDomain(DomainStart=expr("x * 0.5", num_6), DomainEnd=expr("x * (-0.5)", num_6))
pl_offset_3 = PlaneOffset(BasePlane=xy, Offset=expr("x *(-1.0)", number_slider_15))
pl_offset_4 = PlaneOffset(BasePlane=xy_2, Offset=expr("x *(-1.0)", number_slider_15))
rectangle_3 = Rectangle(Plane=pl_offset_3, XSize=dom_3, YSize=dom_3, Radius=0)  # -> Rectangle, Length
rectangle_4 = Rectangle(Plane=pl_offset_4, XSize=dom_3, YSize=dom_3, Radius=0)  # -> Rectangle, Length
expression = Expression(x=number_slider_16, Expression="x * (-1.0)")
# Box Feet
# Box Feet
expression_2 = Expression(x=number_slider_16, Expression="x * (-1.0)")
boxrec_3 = BoxRectangle(Rectangle=rectangle_4.Rectangle, Height=expression)
boxrec_4 = BoxRectangle(Rectangle=rectangle_3.Rectangle, Height=expression_2)
preview_5 = CustomPreview(
    Geometry=[boxrec_3, boxrec_4],
    Material={diffuse=RGB(228, 178, 227), emission=RGB(68, 53, 68), shine=0.5, specular=RGB(255, 254, 254), transparency=0})

# ==== cluster Cluster
C = ClusterInput()
midpt = CurveMiddle(Curve=C)
len = Length(Curve=C)
L = ClusterOutput(len)
M = ClusterOutput(midpt)

# ==== cluster Cluster_2
pt = ClusterInput()
B = ClusterInput()
pt_2 = Point(pt)
Z = UnitZ(Factor=1)
vec2pt = Vector2Pt(PointA=pt_2, PointB=B, Unitize=True)  # -> Vector, Length
xprod = CrossProduct(VectorA=vec2pt.Vector, VectorB=Z, Unitize=True)  # -> Vector, Length
xprod_2 = CrossProduct(VectorA=xprod.Vector, VectorB=vec2pt.Vector, Unitize=True)  # -> Vector, Length
B_2 = ClusterInput()
multiplication = Multiplication(A=vec2pt.Vector, B=B_2)
B_3 = ClusterInput()
multiplication_2 = Multiplication(A=xprod_2.Vector, B=B_3)
addition = Addition(A=pt_2, B=multiplication)
R = ClusterOutput(multiplication_2)
R_2 = ClusterOutput(addition)

# ==== cluster Compass02
pln = ClusterInput()
num = ClusterInput()
pln_2 = Plane(pln)
num_2 = Number(num)
pt = Point(pln_2)
panel = Panel("""0
270
180
90""")
series = Series(Start=0, Step="10", Count="36")
deplane = DeconstructPlane(Plane=pln_2)  # -> Origin, XAxis, YAxis, ZAxis
multiplication = Multiplication(A=deplane.YAxis, B=num_2)
division = Division(A=num_2, B="2")
move = Move(Geometry=deplane.Origin, Motion=multiplication)  # -> Geometry, Transform
cir = Circle(Plane=pln_2, Radius=num_2)
rotate = Rotate(Geometry=move.Geometry, Angle=degrees(panel), Plane=pt)  # -> Geometry, Transform
rotate_2 = Rotate(Geometry=move.Geometry, Angle=degrees(series), Plane=pt)  # -> Geometry, Transform
line = LineSDL(Start=deplane.Origin, Direction=deplane.YAxis, Length=division)
subtraction = Subtraction(A=rotate.Geometry, B=deplane.Origin)
subtraction_2 = Subtraction(A=rotate_2.Geometry, B=deplane.Origin)
division_2 = Division(A=subtraction, B="-15")
division_3 = Division(A=subtraction_2, B="-20")
addition = Addition(A=rotate.Geometry, B=division_2)
addition_2 = Addition(A=rotate_2.Geometry, B=division_3)
subtraction_3 = Subtraction(A=addition, B=pt)
ln = Line(StartPoint=rotate_2.Geometry, EndPoint=addition_2)
ln_2 = Line(StartPoint=rotate.Geometry, EndPoint=addition)
move_2 = Move(Geometry=pt, Motion=subtraction_3)  # -> Geometry, Transform
G = ClusterOutput(move_2.Geometry)
L = ClusterOutput(line)
L_2 = ClusterOutput(ln_2)
C = ClusterOutput(cir)
L_3 = ClusterOutput(ln)
